# Grasshopper definition 02_Cube_walk.gh (Grasshopper 1.0.8)
# plug-ins: RhinoCodePluginGH

pt = ConstructPoint(XCoordinate=0, YCoordinate=0, ZCoordinate=0)
create_vectrs = Python3Script()  # -> out, directions
# ---------- create_vectrs: Python ----------
import Rhino.Geometry as geom

directions = [geom.Vector3d(1,0,0), 
                geom.Vector3d(-1,0,0), 
                geom.Vector3d(0,1,0), 
                geom.Vector3d(0,-1,0),
                geom.Vector3d(0,0,1),
                geom.Vector3d(0,0,-1),
                ]
# ---------- end create_vectrs ----------
panel = Panel(create_vectrs.directions)
panel_2 = Panel("""1.0
1.0
1.0
1.0
1.0
1.0""")
cube_walk = Python3Script(start=pt, directions=create_vectrs.directions, probalities=panel_2)  # -> out, geo_out; inputs directions: list of Vector3d, probalities: list of Double; unedited script template
geo = Geometry(cube_walk.geo_out)
